# Grasshopper definition 20181229_WIPFullMockup.gh (Grasshopper 0.9.76)
# plug-ins: Python Interpreter, Kangaroo2 Components

# ---- group: Proxy Reset
python_script = PythonScript()
# ---------- python_script: Python ----------
from compas.rpc import Proxy
compas = Proxy()
compas.stop_server()
compas = Proxy()
# ---------- end python_script ----------

# ----
rectangle = Rectangle(Plane=PlaneXY(0, 0, 0), XSize="-5 to 5", YSize="-5 to 5", Radius=0)  # -> Rectangle, Length
mesh_surface = MeshSurface(Surface=rectangle.Rectangle, UCount=5, VCount=5, Overhang=True, Equalize=False)
mesh = Mesh(mesh_surface)
deconstruct_mesh = DeconstructMesh(Mesh=mesh)  # -> Vertices, Faces, Colours, Normals
cluster = Cluster(mesh=mesh)
createloads = CreateLoads(loaded_point_s=deconstruct_mesh.Vertices)
meshcorners = MeshCorners(Mesh=mesh, Angle=2.35619449)
cluster_2 = Cluster_2(element_type="e", attribute_name="q", attribute_values="2")
point = Point(meshcorners)
data = Data(createloads)
cluster_3 = Cluster_4(formdiagram=cluster, anchor_points=point, loads=data, elements_modifications_instructions=cluster_2)

# ---- group: DisassembleStructuralDesign
cluster_4 = Cluster_5()  # -> structuraldesign_1, forcediagram_1; disabled

# ---- group: Γ
data_2 = Data(cluster_3)

# ----
cluster_5 = Cluster_7(formdiagram=cluster, anchor_points=point, loads=data, elements_modifications_instructions=cluster_2)
data_3 = Data(cluster_5)
cluster_6 = Cluster_8(formdiagram=data_3)
data_4 = Data(cluster_6)
cluster_7 = Cluster_9(structuraldesign_⓿=data_4)  # -> structuraldesign_1, forcediagram_1
panel = Panel("f")
key_value_search = KeyValueSearch()
data_5 = Data(data_4)
data_6 = Data(cluster_7.structuraldesign_1)
α = Alpha(Slider(90, range=0..100))
kmax = MaxIterations(Slider(100, range=0..100))
forcedensitysolver = ForceDensitySolver(structuraldesign_⓿=data_5)  # -> structuraldesign_➊, forcediagram_➊, forces_➊, lengths_➊
cluster_8 = Cluster_10(structuraldesign_⓿=data_6, alpha=α, maxiterations=kmax)  # -> structuraldesign_➊, formdiagram_➊, forcediagram_➊, log
python_script_2 = PythonScript(x=forcedensitysolver.forcediagram_➊)  # -> out, a
# ---------- python_script_2: Python ----------
print list(x.edges(True))
# ---------- end python_script_2 ----------
python_script_3 = PythonScript()  # -> out, guid
# ---------- python_script_3: Python ----------
from compas_pattern.cad.rhino.utilities import draw_mesh

guid = draw_mesh(quad_mesh_datastructure, group = False)
# ---------- end python_script_3 ----------
cluster_9 = Cluster_12(structural_design=forcedensitysolver.structuraldesign_➊)  # -> attributes_names_2, attributes_values
cluster_10 = Cluster_12(structural_design=forcedensitysolver.structuraldesign_➊)  # -> attributes_names_2, attributes_values
cluster_11 = Cluster_5()  # -> structuraldesign_1, forcediagram_1
data_7 = Data(cluster_8.formdiagram_➊)  # disabled
data_8 = Data(cluster_8.forcediagram_➊)  # disabled
cluster_12 = Cluster_6(diagram=forcedensitysolver.forcediagram_➊)
cluster_13 = Cluster_6(diagram=data_7)  # disabled
panel_3 = Panel(cluster_9.attributes_names_2)
structdsg_⓿ = StructuralDesign⓿(cluster_8.structuraldesign_➊)
data_9 = Data(Slider(100, range=0..100))
data_10 = Data(Slider(5, range=0..10))
mesh_2 = Mesh(cluster_12)
data_11 = Data()
mesh_3 = Mesh(cluster_13)  # disabled
mesh_edges = MeshEdges(Mesh=mesh_2)  # -> NakedEdges, InteriorEdges, NonManifoldEdges
python = PythonScript(cDtaStruct=data_11)  # -> out, vKeysL_Vertices, rgPtsL_Vertices, eKeysL_Edges, rgLnsL_Edges, vKeysL_Anchs, rgPtsL_Anchs, vKeysL_LddVertices, rgPtsL_LddVertices, rgVecsL_VerticesLds
# ---------- python: Python ----------
import compas_ghc.utilities.Convertors as cvt
reload(cvt)

from compas_ghc.utilities.Convertors import DisassembleCompasDataStructures as DiasmCpDtaStruct
from compas_ghc.utilities.Convertors import DrawDisassembledCompasDataStructures as DwDiasmdCpDtaStruct
#from compas_ghc.utilities.InputsOutputsProcessing import GrasshopperInputsGate
#from compas_ghc.utilities.InputsOutputsProcessing import IsCompasDataStructure as IsCpDtaStruct
#from compas_ghc.utilities.InputsOutputsProcessing import SetDefaultInput as SetDfltInp

_cDtaStruct             = cDtaStruct
_dct_DiasmdDta          = DiasmCpDtaStruct(_cDtaStruct)

_vKeysL_Vertices        = _dct_DiasmdDta['vertices']['vKeys'] 
_eKeysL_Edges           = _dct_DiasmdDta['edges']['eKeys'] 
_eKeysL_Edges           = [str(_eKey) for _eKey in _eKeysL_Edges]
_vKeysL_Anchs           = _dct_DiasmdDta['anchors']['vKeys']
_vKeysL_LddVertices     = _dct_DiasmdDta['loads']['vKeys']

_rgPtsL_Vertices, _rgLnsL_Edges, _rgPtsL_Anchs, _rgPtsL_LddVertices, _rgVecsL_VerticesLds = DwDiasmdCpDtaStruct(_dct_DiasmdDta)

vKeysL_Vertices         = _vKeysL_Vertices
rgPtsL_Vertices         = _rgPtsL_Vertices

eKeysL_Edges            = _eKeysL_Edges
rgLnsL_Edges            = _rgLnsL_Edges

vKeysL_Anchs            = _vKeysL_Anchs
rgPtsL_Anchs            = _rgPtsL_Anchs

vKeysL_LddVertices      = _vKeysL_LddVertices
rgPtsL_LddVertices      = _rgPtsL_LddVertices
rgVecsL_VerticesLds     = _rgVecsL_VerticesLds

import rhinoscriptsyntax as rs


#print (_dct_DiasmdData)
#if IsCpDtaStruct(_cDtaStruct):
#    pass
# ---------- end python ----------
cluster_14 = Cluster_11(structuraldesign_⓿=structdsg_⓿, maxiterations=data_9, maxheight=data_10)  # -> structuraldesign_➊, formdiagram_➊
merge = Merge(Data1=mesh_edges.NakedEdges, Data2=mesh_edges.InteriorEdges)
panel_4 = Panel(cluster_9.attributes_values)
python_script_4 = PythonScript()  # -> out, guid; disabled; same code as python_script_3
pt = Point(python.rgPtsL_LddVertices)
vec = Vector(python.rgVecsL_VerticesLds)
int = Integer(python.vKeysL_LddVertices)
int_2 = Integer(python.vKeysL_Vertices)
pt_2 = Point(python.rgPtsL_Vertices)
txt = Text(python.eKeysL_Edges)
crv = Curve(python.rgLnsL_Edges)
int_3 = Integer(python.vKeysL_Anchs)
pt_3 = Point(python.rgPtsL_Anchs)
python_script_5 = PythonScript()  # -> out
# ---------- python_script_5: Python ----------
#print (globals())

for _k, _attr in globals().items():
    print (_k)
# ---------- end python_script_5 ----------
data_12 = Data(cluster_14.formdiagram_➊)
python_script_6 = PythonScript()  # -> out, a
# ---------- python_script_6: Python ----------
class testCls():
    def __init__(self):
        self.a = 1
    
    def dp(self):
        new = self.__class__()
        return new
        
test = testCls()
test2 = test.dp()

print (test.a)
print (test2.a)
# ---------- end python_script_6 ----------
cluster_15 = Cluster_6(diagram=data_12)
mesh_4 = Mesh(cluster_15)

# ==== cluster Cluster
mesh = ClusterInput()
data = Data(mesh)
python_script = PythonScript(RGMesh=data)  # -> out, CGHDiag; inputs RGMesh: Mesh
# ---------- python_script: Python ----------
from compas_ghc.Utilities.InputsOutputsProcessing           import GrasshopperInputsGate

if GrasshopperInputsGate(RGMesh, 'Mesh'):
    from compas_ghc.Utilities.CGHDataStructuresToRCGeometries   import RGMeshToCompasDataStructure as RGMeshToCDtaStruct
    from compas_ghc.DataStructures.CGHDiagrams                  import CGHDiagram
    _RGMesh         = RGMesh
    _CGHDiag        = RGMeshToCDtaStruct(_RGMesh, CGHDiagram)
    CGHDiag = _CGHDiag
# ---------- end python_script ----------
data_2 = Data(python_script.CGHDiag)
panel = Panel(data_2)
diagram = ClusterOutput(data_2)

# ==== cluster CreateLoads
load_vector_s = ClusterInput()
loaded_point_s = ClusterInput()
vec = Vector(load_vector_s)
pt = Point(loaded_point_s)
bool = Boolean()
vec_2 = Vector("0,0,-1")
python = PythonScript(rgPtsL=pt, rgVecsL=vec, rgVec_DfltLd=vec_2, bool_RedistrLds=bool)  # -> out, structLdsL; inputs rgPtsL: list of Point3d, rgVecsL: list of Vector3d, rgVec_DfltLd: Vector3d
# ---------- python: Python ----------
from compas_ghc.Utilities.InputsOutputsProcessing import GrasshopperInputsGate
from compas_ghc.Utilities.InputsOutputsProcessing import SetDefaultInput as SetDfltInp
from compas_ghc.Utilities.InputsOutputsProcessing import MatchListsLengths as MatchLstLgths
from compas_ghc.DataStructures.CGHStructuralLoad  import CGHStructuralLoad as CGHStructLd

#Process inputs and match lists
_rgPtsL = rgPtsL
_rgVecsL = SetDfltInp(rgVecsL, rgVec_DfltLd, bool_LstOtp = True)

_len_Pts = len(_rgPtsL)
_len_Vecs = len(_rgVecsL)
_rgVecsL = MatchLstLgths(_rgPtsL, _rgVecsL)

_zipLdsInfo = zip(_rgPtsL, _rgVecsL)

if _len_Pts > 0: #GrasshopperInputsGate(_rgPtsL, 'Guid'):
    _structLdsL = []
    for __rgPt, __rgVec in _zipLdsInfo:
        
        print (__rgPt, __rgVec)
        __coords    = [__rgPt.X, __rgPt.Y, __rgPt.Z]
        __vec       = [__rgVec.X, __rgVec.Y, __rgVec.Z]
        __structLd  = CGHStructLd(__coords, __vec)
        _structLdsL.append(__structLd)
    structLdsL = _structLdsL
# ---------- end python ----------
data = Data(python.structLdsL)
cghloads = ClusterOutput(data)

# ==== cluster Cluster_2
list_of_elements_keys = ClusterInput()  # If no keys are entered, the attribute value will apply to all elements.
element_type = ClusterInput()  # 'v': vertex, 'e': edge
attribute_name = ClusterInput()  # Input single string/text entry.
attribute_values = ClusterInput()  # Enter one value to be applied to all elements keyed, or enter one value per element keyed.
data = Data(element_type)
data_2 = Data(attribute_name)
data_3 = Data(attribute_values)
data_4 = Data(list_of_elements_keys)
python = PythonScript(char_ElemsTyp=data, str_AttrNm=data_2, keysL_Elems=data_4, dtaL_AttrVals=data_3)  # -> out, instsElemsAttrsMod; inputs keysL_Elems: list, dtaL_AttrVals: list
# ---------- python: Python ----------
from compas_ghc.DesignSpecification import InstructionsContainer  as _InstructionsContainer 
reload(_InstructionsContainer)

from compas_ghc.Utilities.InputsOutputsProcessing import GrasshopperInputsGate
from compas_ghc.Utilities.InputsOutputsProcessing import SetDefaultInput as SetDfltInp

from compas_ghc.DesignSpecification.InstructionsContainer import ElementsAttributesModificationInstructions as ElemsAttrsModInsts

_char_ElemsTyp = char_ElemsTyp
if GrasshopperInputsGate(_char_ElemsTyp, 'str'):
    _instsElemsAttrsMod = ElemsAttrsModInsts(_char_ElemsTyp, str_AttrNm, dtaL_AttrVals, keysL_Elems) 
    
    instsElemsAttrsMod = _instsElemsAttrsMod
# ---------- end python ----------
data_5 = Data(python.instsElemsAttrsMod)
elements_attributes_modification_instruc = ClusterOutput(data_5)

# ==== cluster Cluster_4
elements_modifications_instructions = ClusterInput()
formdiagram = ClusterInput()
loads = ClusterInput()
anchor_points = ClusterInput()
data = Data(elements_modifications_instructions)
data_2 = Data(formdiagram)
data_3 = Data(loads)
data_4 = Data(anchor_points)
data_5 = Data(data_3)
python = PythonScript(inp_Dta=data_2)  # -> formDiag, str_InpTyp, strCoordsL
# ---------- python: Python ----------
from compas_ghc.DataStructures.CGHDiagrams import CGHFormDiagram
if inp_Dta is not None:
    from copy import deepcopy
    _inp_Dta = deepcopy(inp_Dta)
    
    _formDiag = None
    _str_ClsNm = _inp_Dta.__class__.__name__
    
    if (_str_ClsNm == 'Guid'):
        from compas_rhino.geometry import RhinoMesh
        _formDiag = CGHFormDiagram.from_vertices_and_faces(*(RhinoMesh.from_guid(_inp_Dta).get_vertices_and_faces()))
        str_InpTyp = 'GUID'
    elif (_str_ClsNm == 'Mesh' or _str_ClsNm == 'CGHDiagram'):
        _formDiag = CGHFormDiagram.from_data(_inp_Dta.to_data())
        str_InpTyp = 'cDtaStruct'
    elif (_str_ClsNm == 'CGHFormDiagram'):
        _formDiag = _inp_Dta
        str_InpTyp = 'CGHFormDiagram'
        
    formDiag = _formDiag
    
if formDiag is not None:
    coordsL = [formDiag.vertex_coordinates(_vKey) for _vKey in formDiag.vertex.keys()]
    strCoordsL = []
    [strCoordsL.append('{'+str(_coords[0])+','+str(_coords[1])+','+str(_coords[2])+'}') for _coords in coordsL]
# ---------- end python ----------
python_2 = PythonScript(structLdsL=data_5)  # -> out, strCoordsL_LdsPos, vecsLw_LdsDirMag; inputs structLdsL: list
# ---------- python_2: Python ----------
from copy import deepcopy
_structLdsL = deepcopy(structLdsL)
_strCoordsL_LdsPos = []
_vecsL = [] 


for _structLd in _structLdsL:
    _coords = _structLd.coords
    _vec    = _structLd.vec
    _strCoordsL_LdsPos.append('{'+str(_coords[0])+','+str(_coords[1])+','+str(_coords[2])+'}')
    _vecsL.append(_vec)

vecsLw_LdsDirMag = [_vecsL] #to address GH's output processing when only one load is supplied
strCoordsL_LdsPos = _strCoordsL_LdsPos
# ---------- end python_2 ----------

# ---- group: !MvToCode
trim = TrimTree(Tree=python.strCoordsL, Depth=1)

# ----
data_6 = Data(python.formDiag)
pt = Point(trim)
pt_2 = Point(python_2.strCoordsL_LdsPos)
data_7 = Data(python_2.vecsLw_LdsDirMag)
pt_3 = Point(pt)
data_8 = Data(data_4)
pt_4 = Point(pt)
data_9 = Data(pt_2)
cluster = Cluster_3(data=data_9, pt=pt_4)
cluster_2 = Cluster_3(data=data_8, pt=pt_3)
data_10 = Data(data_6)
int = Integer(cluster_2)
int_2 = Integer(cluster)
data_11 = Data(data)
data_12 = Data(data_10)
int_3 = Integer(int)
data_13 = Data(data_7)
data_14 = Data(int_2)
python_3 = PythonScript(formDiag_0=data_12, vKeysL_Anchs=int_3, vKeysL_LdsPos=data_14, vecsLw_LdsDirMag=data_13, instsElemsAttrsModL=data_11)  # -> out, formDiag_1; inputs vKeysL_Anchs: list of Int32, vKeysL_LdsPos: list of Int32, vecsLw_LdsDirMag: list, instsElemsAttrsModL: list
# ---------- python_3: Python ----------
from compas_ghc.Utilities.InputsOutputsProcessing import GrasshopperInputsGate

if GrasshopperInputsGate(formDiag_0, 'CGHFormDiagram'):
    from copy import deepcopy
    _formDiag_0 = deepcopy(formDiag_0)
    
    _vKeysL_Anchs = deepcopy(vKeysL_Anchs)
    _vKeysL_LdsPos = deepcopy(vKeysL_LdsPos)
    _vecsL_LdsDirMag = deepcopy(vecsLw_LdsDirMag[0])
    _instsElemsAttrsModL = deepcopy(instsElemsAttrsModL)
    
    from compas_ghc.Utilities.InputsOutputsProcessing import SetDefaultInput as SetDfltInp
    from compas_ghc.DataStructures.CGHStructuralDesign import CGHStructuralDesign as StructDsg
    from compas_ghc.DesignSpecification.FormDiagramModifications import ImplementElementsModifications as ImplElemsMods
    
    if len(_vKeysL_Anchs) > 0:
        _formDiag_0.set_vertices_attribute('is_anchor', True, _vKeysL_Anchs)
        _formDiag_0.update_boundaries()
        
    if len(_vKeysL_LdsPos) > 0:
        zipLdsInfo = zip(_vKeysL_LdsPos, _vecsL_LdsDirMag)
        for __vKey_LdPos, __vec_LdDirMag in zipLdsInfo:
#            print ('loaded vKey: ', __vKey_LdPos, ' with: ', __vec_LdDirMag)
            _formDiag_0.set_vertex_attributes(__vKey_LdPos, ['px','py','pz'],__vec_LdDirMag)
    
    if len (_instsElemsAttrsModL) > 0 and _instsElemsAttrsModL[0] is not None:
        ImplElemsMods(_formDiag_0, _instsElemsAttrsModL)

    formDiag_1 = _formDiag_0
    
    

#for _vKey, _attr in formDiag_1.vertex.items():
#    print (_vKey, _attr)
# ---------- end python_3 ----------
data_15 = Data(python_3.formDiag_1)
formdiagram_1 = ClusterOutput(data_15)

# ==== cluster Cluster_5
structuraldesign_0 = ClusterInput()
createdualdiagram = PythonScript(structDsg_0=structuraldesign_0)  # -> formDiag, forceDiag
# ---------- createdualdiagram: Python ----------
from compas_ghc.Utilities.InputsOutputsProcessing import GrasshopperInputsGate

if GrasshopperInputsGate(structDsg_0, 'CGHStructuralDesign'):
    _structDsg_0    = structDsg_0
    
    _formDiag       = _structDsg_0.formDiag
    _forceDiag      = _structDsg_0.forceDiag
    
    formDiag        = _formDiag
    forceDiag       = _forceDiag
# ---------- end createdualdiagram ----------
structuraldesign_1 = ClusterOutput(createdualdiagram.formDiag)
forcediagram_1 = ClusterOutput(createdualdiagram.forceDiag)

# ==== cluster Cluster_6
diagram = ClusterInput()
data = Data(diagram)
python = PythonScript(cDtaStruct=data)  # -> out, rgMesh
# ---------- python: Python ----------
from compas_ghc.Utilities.InputsOutputsProcessing import GrasshopperInputsGate
from compas_ghc.Utilities.InputsOutputsProcessing import IsCompasDataStructure as IsCpDtaStruct
from compas_ghc.Utilities.InputsOutputsProcessing import SetDefaultInput as SetDfltInp


if IsCpDtaStruct(cDtaStruct):
    _cDtaStruct = cDtaStruct.CreateDuplicate()
    
    from compas_ghc.Utilities.Convertors import ConstructRhinocerosMeshFromCompasDataStructure as ConstrRGMeshFrCDtaStruct
    _rgMesh = ConstrRGMeshFrCDtaStruct(_cDtaStruct)
    rgMesh = _rgMesh
# ---------- end python ----------
data_2 = Data(python.rgMesh)
mesh = ClusterOutput(data_2)

# ==== cluster Cluster_7
formdiagram = ClusterInput()
loads = ClusterInput()
elements_modifications_instructions = ClusterInput()
anchor_points = ClusterInput()
data = Data(elements_modifications_instructions)
data_2 = Data(loads)
data_3 = Data(formdiagram)
data_4 = Data(anchor_points)
data_5 = Data(data_2)
python = PythonScript(inp_Dta=data_3)  # -> formDiag, str_InpTyp, strCoordsL; same code as python
python_2 = PythonScript(structLdsL=data_5)  # -> out, strCoordsL_LdsPos, vecsLw_LdsDirMag; inputs structLdsL: list; same code as python_2

# ---- group: !MvToCode
trim = TrimTree(Tree=python.strCoordsL, Depth=1)

# ----
data_6 = Data(python.formDiag)
pt = Point(trim)
pt_2 = Point(python_2.strCoordsL_LdsPos)
data_7 = Data(python_2.vecsLw_LdsDirMag)
pt_3 = Point(pt)
pt_4 = Point(pt)
data_8 = Data(data_4)
data_9 = Data(pt_2)
cluster = Cluster_3(data=data_9, pt=pt_4)
cluster_2 = Cluster_3(data=data_8, pt=pt_3)
data_10 = Data(data_6)
int = Integer(cluster_2)
int_2 = Integer(cluster)
data_11 = Data(data)
data_12 = Data(data_10)
int_3 = Integer(int)
data_13 = Data(data_7)
data_14 = Data(int_2)
python_3 = PythonScript(formDiag_0=data_12, vKeysL_Anchs=int_3, vKeysL_LdsPos=data_14, vecsLw_LdsDirMag=data_13, instsElemsAttrsModL=data_11)  # -> out, formDiag_1; inputs vKeysL_Anchs: list, vKeysL_LdsPos: list, vecsLw_LdsDirMag: list, instsElemsAttrsModL: list
# ---------- python_3: Python ----------
from compas_ghc.Utilities.InputsOutputsProcessing import GrasshopperInputsGate

if GrasshopperInputsGate(formDiag_0, 'CGHFormDiagram'):
    from copy import deepcopy
    _formDiag_1 = deepcopy(formDiag_0)
    
    _vKeysL_Anchs = deepcopy(vKeysL_Anchs)
    _vKeysL_LdsPos = deepcopy(vKeysL_LdsPos)
    _vecsL_LdsDirMag = deepcopy(vecsLw_LdsDirMag[0])
    _instsElemsAttrsModL = deepcopy(instsElemsAttrsModL)
    
    from compas_ghc.Utilities.InputsOutputsProcessing import SetDefaultInput as SetDfltInp
    from compas_ghc.DataStructures.CGHStructuralDesign import CGHStructuralDesign as StructDsg
    from compas_ghc.DesignSpecification.FormDiagramModifications import ImplementElementsModifications as ImplElemsMods
    
    if len(_vKeysL_Anchs) > 0:
        _formDiag_1.set_vertices_attribute('is_anchor', True, _vKeysL_Anchs)
        _formDiag_1.update_boundaries()
        
    if len(_vKeysL_LdsPos) > 0:
        zipLdsInfo = zip(_vKeysL_LdsPos, _vecsL_LdsDirMag)
        for __vKey_LdPos, __vec_LdDirMag in zipLdsInfo:
            _formDiag_1.set_vertex_attributes(__vKey_LdPos, ['px','py','pz'],__vec_LdDirMag)
    
    if len (_instsElemsAttrsModL) > 0 and _instsElemsAttrsModL[0] is not None:
        ImplElemsMods(_formDiag_1, _instsElemsAttrsModL)

    formDiag_1 = _formDiag_1
    
    

#for _vKey, _attr in formDiag_1.vertex.items():
#    print (_vKey, _attr)
# ---------- end python_3 ----------
data_15 = Data(python_3.formDiag_1)
formdiagram_1 = ClusterOutput(data_15)

# ==== cluster Cluster_8
formdiagram = ClusterInput()
forcediagram = ClusterInput()
data = Data(formdiagram)
data_2 = Data(forcediagram)
python = PythonScript(formDiag=data, forceDiag=data_2)  # -> structDsg
# ---------- python: Python ----------
from compas_ghc.DataStructures import CGHStructuralDesign as _CGHStructDsg
reload(_CGHStructDsg)

from compas_ghc.DataStructures.CGHStructuralDesign import CGHStructuralDesign as StructDsg

#if form or force diagrams are valid?
_structDsg = StructDsg()

if formDiag is not None:
    _structDsg.SetFormDiagram(formDiag.CreateDuplicate())
    
if forceDiag is not None:
    _structDsg.SetForceDiagram(forceDiag.CreateDuplicate())
    
structDsg = _structDsg
# ---------- end python ----------
data_3 = Data(python)
structuraldesign = ClusterOutput(data_3)

# ==== cluster Cluster_9
structuraldesign_⓿ = ClusterInput()
data = Data(structuraldesign_⓿)
createdualdiagram = PythonScript(structDsg_0=data)  # -> structDsg_1, forceDiag_1
# ---------- createdualdiagram: Python ----------
from compas_ghc.DataStructures.CGHDiagrams import CGHForceDiagram 
from compas_ghc.DataStructures.CGHStructuralDesign import CGHStructuralDesign as CGHStructDsg
if structDsg_0 is not None:
    _structDsg_1        = structDsg_0.CreateDuplicate()
    _formDiag_1         = _structDsg_1.formDiag
    _forceDiag_1        = CGHForceDiagram.from_formdiagram(_formDiag_1)
    _structDsg_1.SetForceDiagram(_forceDiag_1)

    structDsg_1 = _structDsg_1
    forceDiag_1 = _forceDiag_1
# ---------- end createdualdiagram ----------
data_2 = Data(createdualdiagram.forceDiag_1)
data_3 = Data(createdualdiagram.structDsg_1)
structuraldesign_1 = ClusterOutput(data_3)
forcediagram_1 = ClusterOutput(data_2)

# ==== cluster Cluster_10
structuraldesign_⓿ = ClusterInput()
alpha = ClusterInput()  # default: 100
maxiterations = ClusterInput()  # default: 100
data = Data(alpha)
data_2 = Data(maxiterations)
data_3 = Data(structuraldesign_⓿)
python = PythonScript(structDsg_0=data_3, flt_Alpha=data, int_KMax=data_2)  # -> out, structDsg_1, formDiag_1, forceDiag_1; inputs int_KMax: Int32
# ---------- python: Python ----------
from compas_ghc.Utilities.InputsOutputsProcessing import GrasshopperInputsGate

if GrasshopperInputsGate(structDsg_0, 'CGHStructuralDesign'):
    _structDsg_0 = structDsg_0.CreateDuplicate()
    
    from compas.rpc import Proxy
    _TNA = Proxy('compas_ghc.StructuralSolvers.TNA.Equilibrium')

    from compas_ghc.Utilities.InputsOutputsProcessing import SetDefaultInput as SetDfltInp
    from compas_ghc.DataStructures.CGHStructuralDesign import CGHStructuralDesign as StructDsg

    from compas_ghc.DataStructures.CGHDiagrams import CGHFormDiagram as FormDiagram
    from compas_ghc.DataStructures.CGHDiagrams import CGHForceDiagram as ForceDiagram
    
    _formDiag_0, _forceDiag_0 = _structDsg_0.OutputDualDiagrams()
    
    _flt_Alpha = SetDfltInp(flt_Alpha, 100)
    _int_KMax = SetDfltInp(int_KMax, 100)

    _formData_0 = _formDiag_0.to_data()
    _forceData_0 = _forceDiag_0.to_data()
    
    try:
        _formData_1, _forceData_1 = _TNA.HorizontalEquilibrium_fromData(_formData_0 , _forceData_0, alpha=_flt_Alpha, kmax=_int_KMax)
        try:
            _formDiag_1     = FormDiagram.from_data(_formData_1)
            _forceDiag_1    = ForceDiagram.from_data(_forceData_1)
        
            _structDsg_1    = StructDsg()
            _structDsg_1.SetDualDiagrams(_formDiag_1, _forceDiag_1)
            
            formDiag_1      = _formDiag_1
            forceDiag_1     = _forceDiag_1
            structDsg_1     = _structDsg_1
        except:
            pass
    except:
        pass
# ---------- end python ----------
data_4 = Data(python.structDsg_1)
data_5 = Data(python.forceDiag_1)
data_6 = Data(python.formDiag_1)
data_7 = Data()
formdiagram_➊ = ClusterOutput(data_6)
log = ClusterOutput(data_7)
structuraldesign_➊ = ClusterOutput(data_4)
forcediagram_➊ = ClusterOutput(data_5)

# ==== cluster Cluster_11
structuraldesign_⓿ = ClusterInput()
maxheight = ClusterInput()
maxiterations = ClusterInput()
data = Data(maxiterations)
data_2 = Data(maxheight)
data_3 = Data(structuraldesign_⓿)
python = PythonScript(structDsg_0=data_3, int_KMax=data, flt_ZMax=data_2)  # -> out, structDsg_1, formDiag_1; inputs int_KMax: Int32
# ---------- python: Python ----------
from compas_ghc.Utilities.InputsOutputsProcessing import GrasshopperInputsGate

if GrasshopperInputsGate(structDsg_0, 'CGHStructuralDesign'):
    from compas.rpc import Proxy
    _TNA = Proxy('compas_ghc.StructuralSolvers.TNA.Equilibrium')
   
    _structDsg_0 = structDsg_0.CreateDuplicate()
    
    from compas_ghc.DataStructures.CGHDiagrams import CGHFormDiagram
    from compas_ghc.Utilities.InputsOutputsProcessing import SetDefaultInput as SetDfltInp
    from compas_ghc.DataStructures.CGHStructuralDesign import CGHStructuralDesign as CGHStructDsg
    
    _formDiag_0, _forceDiag_0 = _structDsg_0.OutputDualDiagrams()
    
    _int_KMax = SetDfltInp(int_KMax, 100)
    _flt_ZMax = SetDfltInp(flt_ZMax, 5)

    _formData_0 = _formDiag_0.to_data()
    _formData_1, _scale = _TNA.VerticalEquilibrium_fromZMax_fromData(_formData_0, zmax = _flt_ZMax, kmax = _int_KMax)
    try:
        _formData_1, _scale = _TNA.VerticalEquilibrium_fromZMax_fromData(_formData_0, zmax = _flt_ZMax, kmax = _int_KMax)
        
        try:
            _formDiag_1     = CGHFormDiagram.from_data(_formData_1)
            _forceDiag_1    = _forceDiag_0.CreateDuplicate()
            _structDsg_1    = CGHStructDsg()
            _structDsg_1.SetDualDiagrams(_formDiag_1, _forceDiag_1)
            
            formDiag_1      = _formDiag_1
            structDsg_1     = _structDsg_1
        except:
            pass
        
    except:
        pass
# ---------- end python ----------
data_4 = Data(python.structDsg_1)
data_5 = Data(python.formDiag_1)
formdiagram_➊ = ClusterOutput(data_5)
structuraldesign_➊ = ClusterOutput(data_4)

# ==== cluster ForceDensitySolver
structuraldesign_⓿ = ClusterInput()
data = Data(structuraldesign_⓿)
python = PythonScript(structDsg_0=data)  # -> out, structDsg_1, formDiag_1, fltsL_EdgeForces, fltsL_EdgeLgths, strsL_ErrMsgs
# ---------- python: Python ----------
from compas_ghc.Utilities.InputsOutputsProcessing import GrasshopperInputsGate
from compas_ghc.Utilities.InputsOutputsProcessing import SetDefaultInput as SetDfltInp
from compas_ghc.DataStructures.CGHStructuralDesign import CGHStructuralDesign as CGHStructDsg


if GrasshopperInputsGate(structDsg_0, 'CGHStructuralDesign'):
    from compas.rpc import Proxy
    _FDM = Proxy('compas_ghc.StructuralSolvers.FDM.FDM')
    
    from compas_ghc.DataStructures.CGHDiagrams import CGHFormDiagram
    
    _flt_TtlSWLd = 0 ##CHANGE
    
    _structDsg_0 = structDsg_0.CreateDuplicate()
    _formDiag = structDsg_0.formDiag
    
    _structDsg_1 = CGHStructDsg()
   
    _formData_0 = structDsg_0.formDiag.to_data()
    _formData_1, _cDctFDSolvRes= _FDM.ForceDensitySolver(_formData_0, _flt_TtlSWLd, bool_LdsRdistrByTrib = False, iMax_LdsRedistr = 5)
    _formDiag_1 = CGHFormDiagram.from_data(_formData_1)
    _structDsg_0.SetFormDiagram(_formDiag_1)
    
    formDiag_1  = _formDiag_1
    structDsg_1 = _structDsg_0
    
    fltsL_EdgeForces    = [_x[0] for _x in _cDctFDSolvRes['f']]
    fltsL_EdgeLgths     = [_x[0] for _x in _cDctFDSolvRes['l']]
# ---------- end python ----------
data_2 = Data(python.structDsg_1)
data_3 = Data(python.fltsL_EdgeForces)
data_4 = Data(python.formDiag_1)
data_5 = Data(python.fltsL_EdgeLgths)
structuraldesign_➊ = ClusterOutput(data_2)
lengths_➊ = ClusterOutput(data_5)
forcediagram_➊ = ClusterOutput(data_4)
forces_➊ = ClusterOutput(data_3)

# ==== cluster Cluster_12
structural_design = ClusterInput()
element_type = ClusterInput()
attributes_names = ClusterInput()
data = Data(attributes_names)
data_2 = Data(structural_design)
data_3 = Data(element_type)
python_script = PythonScript(structDsg=data_2, char_ElemTyp=data_3, str_FltrByAttrName=data)  # -> out, GHDtaTr_Lgds, GHDtaTr_Vals
# ---------- python_script: Python ----------
from compas_ghc.ResultsExtraction import ExtractElementsData
reload (ExtractElementsData)

from compas_ghc.Utilities.InputsOutputsProcessing import GrasshopperInputsGate
from compas_ghc.Utilities.InputsOutputsProcessing import SetDefaultInput as SetDfltInp
from compas_ghc.DataStructures.CGHStructuralDesign import CGHStructuralDesign as CGHStructDsg
from compas_ghc.ResultsExtraction.ExtractElementsData import ExtractElementsData

if GrasshopperInputsGate(structDsg, 'CGHStructuralDesign'):
    _char_ElemTyp           = SetDfltInp(char_ElemTyp, 'e')
    _str_FltrByAttrName     = SetDfltInp(str_FltrByAttrName, None)
    _GHDtaTr_Lgds, _GHDtaTr_Vals = ExtractElementsData(structDsg.formDiag, _char_ElemTyp, _str_FltrByAttrName)
    
GHDtaTr_Lgds    = _GHDtaTr_Lgds
GHDtaTr_Vals    = _GHDtaTr_Vals
# ---------- end python_script ----------
data_4 = Data(python_script.GHDtaTr_Lgds)
data_5 = Data(python_script.GHDtaTr_Vals)
attributes_names_2 = ClusterOutput(data_4)
attributes_values = ClusterOutput(data_5)

# ==== cluster Cluster_3
data = ClusterInput()
pt = ClusterInput()

# ---- group: Find indices of points
data_2 = Data(data)
python = PythonScript(infoL_Anchs=data_2)  # -> iL_Anchs, rgPtsL_Anchs; inputs infoL_Anchs: list
# ---------- python: Python ----------
iL_Anchs = []
rgPtsL_Anchs = []
for _info_Anch in infoL_Anchs:
    _typ = str(type(_info_Anch))
    print _typ
    if _typ == "<type 'Point3d'>":
        rgPtsL_Anchs.append(_info_Anch)
        
    elif _typ == "<type 'str'>" or _typ == "<type 'str'>":
        try:
            _i = int(_info_Anch)
            iL_Anchs.append(_info_Anch)
        except:
            pass
# ---------- end python ----------
pt_2 = Point(pt)
pt_3 = Point(python.rgPtsL_Anchs)
pt_4 = Point(pt_3)
cp = ClosestPoint(Point=pt_4, Cloud=pt_2)  # -> ClosestPoint, CPIndex, Distance
int = Integer(python.iL_Anchs)
int_2 = Integer(cp.CPIndex)
merge = Merge(Data1=int, Data2=int_2)
cset = CreateSet(List=merge)  # -> Set, Map
int_3 = Integer(cset.Set)

# ----
tstat = TreeStatistics(Tree=pt_2)  # -> Paths, Length, Count; disabled
panel = Panel(tstat.Paths)  # disabled

int_4 = ClusterOutput(int_3)
